# Grasshopper definition param_extractor_min.gh (Grasshopper 1.0.7)

# ---- group: Set the height of the well-head in the dimension you want in the JSON
# Here is the main script
height_of_well = Panel("80")

# ---- group: write down the mouding type of each slab, slarting with the lowest one
write_down_the_moulding_for_the_well_hea = Panel("""listello
toro
listello
toro
listello
toro
listello
gola_f
listello
gola_rev
toro""")  # "Write down the moulding for the well-head"

# ---- group: Write down the polygonal shape of base then top of each slab. Start with the lowest one
write_down_the_polygonal_shape_of_base_a = Panel("""150
150
150
150
150
150
6
6
6
6
6""")  # "Write down the polygonal shape of base and top"
list_of_polygons = Panel("""150
4
5
6
8
10""")

# ---- group: Draw a line as diameter of the well-head. Used to set the center
line = Line(Line((-2.171874135, 7.70227572, 0), (9.186079311, 7.730045777, 0)))
curve_middle = CurveMiddle(Curve=line)
deconstruct = Deconstruct(Point=curve_middle)  # -> XComponent, YComponent, ZComponent

# ----
pt = Point([Point(9.217326202, 7.710048577, 0), Point(9.454185352, 12.88451001, 0), Point(9.199106267, 8.092667204, 0), Point(8.597848425, 8.548165569, 0), Point(9.053346791, 12.15571262, 0), Point(9.435965417, 12.61121099, 0)])
image_resource = ImageResource("D:\Documents\Polito\Erasmus\DH\proj\cheatsheet_mouldings.png")

# ---- group: Set points to extract dimensions
# How to set points: Method:
# 
# 1. First point at base corner of lowest slab
# 
# 2. Second point at top corner of highest slab
# 
# 3. Then Clic on the righter corner between two slabs
deconstruct_2 = Deconstruct(Point=pt)  # -> XComponent, YComponent, ZComponent

# ----
panel = Panel(deconstruct_2.YComponent)
split = SplitList(List=deconstruct_2.YComponent, Index="2")  # -> ListA, ListB
item = ListItem(List=deconstruct_2.XComponent, Index="0", Wrap=True)
split_2 = SplitList(List=deconstruct_2.XComponent, Index="2")  # -> ListA, ListB

# ---- group: extract top and base points, use real height to compute scale factor
list_item = ListItem(List=split.ListA, Index="1", Wrap=True)
list_item_2 = ListItem(List=split.ListA, Index="0", Wrap=True)
subtraction = Subtraction(A=list_item, B=list_item_2)
division = Division(A=subtraction, B=height_of_well)
scale_factor = Panel(division)

# ----
ins = InsertItems(List=split_2.ListB, Item=item, Indices="0", Wrap=True)

# ---- group: compute base and top coordinate of slabs, use scale factor to get real dimensions
subtraction_2 = Subtraction(A=split.ListB, B=list_item_2)
division_2 = Division(A=subtraction_2, B=scale_factor)
common_top_and_base = Panel(division_2)
insert_items = InsertItems(List=common_top_and_base, Item=height_of_well, Indices=-1, Wrap=True)
insert_items_2 = InsertItems(List=common_top_and_base, Item="0", Indices="0", Wrap=True)
top_z = Panel(insert_items)
base_z = Panel(insert_items_2)

# ---- group: set radius-base et right dimensions
subtraction_3 = Subtraction(A=ins, B=deconstruct.XComponent)
division_3 = Division(A=subtraction_3, B=scale_factor)
radius_base = Panel(division_3)

# ----
int = Integer(write_down_the_polygonal_shape_of_base_a)
round = Round(Number=division_3)  # -> Nearest, Floor, Ceiling
round_2 = Round(Number=insert_items_2)  # -> Nearest, Floor, Ceiling
round_3 = Round(Number=insert_items)  # -> Nearest, Floor, Ceiling

# ---- group: Write a JSON file
ghpython_script = GhPythonScript(
    run=Button(),
    w=round_2.Nearest,
    v=round_3.Nearest,
    u=round.Nearest,
    z=round.Nearest,
    y=write_down_the_moulding_for_the_well_hea,
    x=int,
    s=int)  # -> out, a
# ---------- ghpython_script: Python ----------
__author__ = "loicr"
__version__ = "2021.11.25"

import rhinoscriptsyntax as rs
import json
filename = 'params_TEMPLATE.json'

entry = {
    "z-base": w,
    "z-top": v,
    "radius-base": u,
    "radius-top": z,
    "polygonal-base": s,
    "polygonal-top": x,
    "moulding-scale": 1,
    "moulding-type": y
}

if run:
    # 1. Read file contents
    with open(filename, "r") as file:
        data = json.load(file)
    # 2. Update json object
    data.append(entry)
    # 3. Write json file
    with open(filename, "w") as file:
        json.dump(data, file, indent=2, sort_keys=True)
# ---------- end ghpython_script ----------
