# Grasshopper definition well_models.gh (Grasshopper 1.0.7)
# plug-ins: Anemone, Kangaroo2 Components

# ---- group: Read parameters from json file
order_of_parameters = Panel("x_start; y_start; x_vstart; y_vstart; x_mid; y_mid; x_vmid; y_vmid; s_vmid; x_end; y_end; x_vend; y_vend")
path = FilePath("C:\Users\loicr\OneDrive\Documents\GitHub\3DVeniceWells\grasshopper_tools\params_TEMPLATE.json")
mouldings = Panel("""0;1;0;1;0;0.5;0;0.5;1;0;0;0;0
0;1;0.5;1;0.5;0.5;0.5;0.5;1;0;0;0.5;0
1;1;1;1;1;1;1;1;1;0;0;0;1
1;1;1;1;1;1;1;1;1;0;0;1;0
1;1;0.5;1;0.5;0.5;0.5;0.5;1;0;0;0.5;0
1;1;1;0.5;0.5;0.5;0.5;0.5;1;0;0;0;0.5
0;1;0.5;1;1;0.66;1;1;1.66;0;0;0.5;0
0.5;1;1;1;1;0.5;1;0.66;2;0;0;0.5;-0.5
0;1;0.5;1;0.5;0.5;0.5;1;1;0;0;0.5;0
0;1;0;1;0;1;0;1;1;1;0;0;0
0;1;0;1;0;1;0;1;1;1;0;1;1
0;1;0.5;1;0.5;0.5;0.5;0.5;1;1;0;0.5;0
0;1;0;0.5;0.5;0.5;0.5;0.5;1;1;0;1;0.5
0;1;0.5;1;1;0.33;1;0.9;0.66;0;0;0.5;0""")
python = GhPythonScript(filePath=path)  # -> out, BaseZ, TopZ, RadiusB, RadiusT, PolygonalB, PolygonalT, MouldScale, MouldType
# ---------- python: Python ----------
__author__ = "chemind"
__version__ = "2021.11.13"

import rhinoscriptsyntax as rs
import json

BaseZ = []
TopZ = []
RadiusB = []
RadiusT = []
PolygonalB = []
PolygonalT = []
MouldScale = []
MouldType = []

#Read JSON data into the datastore variable
if filePath:
    file = open(filePath)
    data = json.load(file)
    
    #Use the new datastore datastructure
    for item in data:
        BaseZ.append(item["z-base"])
        TopZ.append(item["z-top"])
        RadiusB.append(item["radius-base"])
        RadiusT.append(item["radius-top"])
        PolygonalB.append(item["polygonal-base"])
        PolygonalT.append(item["polygonal-top"])
        MouldScale.append(item["moulding-scale"])
        MouldType.append(item["moulding-type"])
# ---------- end python ----------
panel = Panel("""listello
toro
cavetto
ovolo
gola
gola_rev
beak
scotia
list_rounded
cavetto_f
ovolo_f
gola_f
gola_rev_f
beak_f
custom1""")
mindex = MemberIndex(Set=panel, Member=python.MouldType)  # -> Index, Count
item = ListItem(List=mouldings, Index=mindex.Index, Wrap=True)
split = TextSplit(Text=item, Separators=";")
flip = FlipMatrix(Data=split)
bang = ExplodeTree(Data=flip)  # -> _0000, _0010, _0020, _0030, _0040, _0050, _0060, _0070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
order_of_parameters_2 = Panel("base-z; top-z; radius-base; radius-top; polygonal-base; polygonal-top; moulding-x-scale; moulding-type")
base_z = Panel(python.BaseZ)
radius_base = Panel(python.RadiusB)
top_z = Panel(python.TopZ)
polygon_base = Panel(python.PolygonalB)
radius_top = Panel(python.RadiusT)
polygon_top = Panel(python.PolygonalT)
moulding_scale = Panel(python.MouldScale)
x_mid = Panel(bang._0040)
y_vec_mid = Panel(bang._0070)
s_vec_mid = Panel(bang._0080)
x_starting = Panel(bang._0000)
y_start = Panel(bang._0010)
y_vec_start = Panel(bang._0030)
y_mid = Panel(bang._0050)
x_vec_mid = Panel(bang._0060)
x_vec_start = Panel(bang._0020)
x_end = Panel(bang._0090)
x_vec_end = Panel(bang._00110)
y_vec_end = Panel(bang._00120)
y_end = Panel(bang._00100)

# ----
image_resource = ImageResource("D:\Documents\Polito\Erasmus\DH\proj\cheatsheet_mouldings.png")
pt = ConstructPoint(XCoordinate=0, YCoordinate=0, ZCoordinate=base_z)
pt_2 = ConstructPoint(XCoordinate=0, YCoordinate=0, ZCoordinate=top_z)

# ---- group: Draw mouldings outline curves
panel_2 = Panel("end point")
panel_3 = Panel("middle point")
pt_3 = ConstructPoint(XCoordinate=x_starting, YCoordinate=y_start, ZCoordinate=0)
pt_4 = ConstructPoint(XCoordinate=x_end, YCoordinate=y_end, ZCoordinate=0)
pt_5 = ConstructPoint(XCoordinate=x_mid, YCoordinate=y_mid, ZCoordinate=0)
pt_6 = ConstructPoint(XCoordinate=x_vec_mid, YCoordinate=y_vec_mid, ZCoordinate=0)
pt_7 = ConstructPoint(XCoordinate=x_vec_start, YCoordinate=y_vec_start, ZCoordinate=0)
pt_8 = ConstructPoint(XCoordinate=x_vec_end, YCoordinate=y_vec_end, ZCoordinate=0)
vec2pt = Vector2Pt(PointA=pt_5, PointB=pt_6, Unitize=False)  # -> Vector, Length
vec2pt_2 = Vector2Pt(PointA=pt_3, PointB=pt_7, Unitize=False)  # -> Vector, Length
vec2pt_3 = Vector2Pt(PointA=pt_4, PointB=pt_8, Unitize=False)  # -> Vector, Length
rev = Reverse(Vector=vec2pt.Vector)
multiplication = Multiplication(A=rev, B=s_vec_mid)
pt_9 = ConstructPoint(XCoordinate=0, YCoordinate=0, ZCoordinate=base_z)
bzspan = BezierSpan(StartPoint=pt_5, StartTangent=multiplication, EndPoint=pt_4, EndTangent=vec2pt_3.Vector)  # -> flatten(Curve), Length, Domain
subtraction = Subtraction(A=top_z, B=base_z)
bzspan_2 = BezierSpan(StartPoint=pt_3, StartTangent=vec2pt_2.Vector, EndPoint=pt_5, EndTangent=vec2pt.Vector)  # -> flatten(Curve), Length, Domain

# ----
panel_4 = Panel("start point")
sort = SortList(Keys=python.RadiusB)  # -> Keys, ValuesA
xy = XYPlane(Origin=pt_2)
xy_2 = XYPlane(Origin=pt)
item_2 = ListItem(List=sort.Keys, Index="0", Wrap=True)

# ---- group: Draw slabs' top and bottom polygons
polygon = Polygon(Plane=xy_2, Radius=radius_base, Segments=polygon_base, FilletRadius=0)  # -> reparameterize(Polygon), Length
polygon_2 = Polygon(Plane=xy, Radius=radius_top, Segments=polygon_top, FilletRadius=0)  # -> Polygon, Length
toggle = BooleanToggle(True)
larger = LargerThan(FirstNumber=polygon_base, SecondNumber="10")  # -> LargerThan, OrEqualTo
cir = Circle(Plane=xy_2, Radius=radius_base)
larger_2 = LargerThan(FirstNumber=polygon_top, SecondNumber="10")  # -> LargerThan, OrEqualTo
cir_2 = Circle(Plane=xy, Radius=radius_top)
cull = CullPattern(List=cir_2, CullPattern=larger_2.LargerThan)
cull_2 = CullPattern(List=cir, CullPattern=larger.LargerThan)
mindex_2 = MemberIndex(Set=larger.LargerThan, Member=toggle)  # -> Index, Count
mindex_3 = MemberIndex(Set=larger_2.LargerThan, Member=toggle)  # -> Index, Count
replace = ReplaceItems(List=polygon.Polygon, Item=cull_2, Indices=mindex_2.Index, Wrap=False)
replace_2 = ReplaceItems(List=polygon_2.Polygon, Item=cull, Indices=mindex_3.Index, Wrap=False)

# ----
equals = Equality(FirstNumber=radius_base, SecondNumber=radius_top)  # -> Equality, Inequality
equals_2 = Equality(FirstNumber=polygon_base, SecondNumber=polygon_top)  # -> Equality, Inequality
equals_3 = Equality(FirstNumber=flatten(mindex.Index), SecondNumber="0")  # -> Equality, Inequality
and = GateAnd(A=equals.Equality, B=equals_2.Equality)
and_2 = GateAnd(A=and, B=equals_3.Inequality)

restart = Button()
lng = ListLength(List=bzspan_2.Curve)
multiplication_2 = Multiplication(A=subtraction, B=moulding_scale)
loop_start = LoopStart(Repeat=lng, Trigger=restart, Data="0")  # -> port, Counter, Data

rulesrf = RuledSurface(CurveA=replace, CurveB=replace_2)
cap = CapHoles(Brep=rulesrf)

# ----
# height of the spheres
number_slider = Slider(-10, range=-100..100)
item_3 = ListItem(List=radius_base, Index="3", Wrap=True)
item_4 = ListItem(List=xy_2, Index="3", Wrap=True)
# height of the spheres
number_slider_2 = Slider(0, range=-100..100)
panel_5 = Panel("8")
item_5 = ListItem(List=and_2, Index=loop_start.Counter, Wrap=True)
item_6 = ListItem(List=polygon_base, Index=loop_start.Counter, Wrap=True)
item_7 = ListItem(List=replace, Index=loop_start.Counter, Wrap=True)
item_8 = ListItem(List=cap, Index=loop_start.Counter, Wrap=True)
item_9 = ListItem(List=bzspan.Curve, Index=loop_start.Counter, Wrap=True)
item_10 = ListItem(List=subtraction, Index=loop_start.Counter, Wrap=True)
item_11 = ListItem(List=multiplication_2, Index=loop_start.Counter, Wrap=True)
item_12 = ListItem(List=bzspan_2.Curve, Index=loop_start.Counter, Wrap=True)
item_13 = ListItem(List=pt_9, Index=loop_start.Counter, Wrap=True)
square_slab = Panel("""0.125
0.375
0.625
0.875""")
polygon_3 = Polygon(Plane=item_4, Radius=item_3, Segments="4", FilletRadius=0)  # -> Polygon, Length
polygon_4 = Polygon(Plane=item_4, Radius=item_3, Segments=4, FilletRadius=0)  # -> Polygon, Length
Z = UnitZ(Factor=number_slider)
Z_2 = UnitZ(Factor=number_slider_2)
panel_6 = Panel("spheres radius")
subtraction_2 = Subtraction(A="3", B="1")
addition = Addition(A=loop_start.Counter, B="-1")
equals_4 = Equality(FirstNumber="3", SecondNumber="0")  # -> Equality, Inequality
list = ValueList({"Corners": 1, "Sides": 2, "Corner+Side": 3}, selected="Corner+Side")
pt_10 = ConstructPoint(XCoordinate=0, YCoordinate=0, ZCoordinate="20")
Z_3 = UnitZ(Factor="200")
division = Division(A=item_2, B="1.5")
cyl = Cylinder(Base=pt_10, Radius=division, Length=Z_3)

# ---- group: Boolean operation: spheres at the corners
# distance of the spheres from the slab
scale = Slider(1.181, range=1..8)
scale_nu = ScaleNU(Geometry=polygon_4.Polygon, Plane=PlaneXY(0, 0, 0), ScaleX=scale, ScaleY=scale, ScaleZ=1)  # -> Geometry, Transform

# ----
move = Move(Geometry=scale_nu.Geometry, Motion=Z)  # -> Geometry, Transform

# ---- group: Boolean operation: spheres at the corners (continued)
mc = MeshCorners(Mesh=move.Geometry, Angle=2.35619449)
sph = Sphere(Base=mc, Radius=Slider(30, range=0..500))

# ---- group: Extrude the moulding profile along the slab perimeter
flip_2 = FlipCurve(Curve=item_7)  # -> Curve, Flag
equals_5 = Equality(FirstNumber=item_6, SecondNumber="150")  # -> Equality, Inequality
pframe = PerpFrame(Curve=item_7, Parameter="0")
join = JoinCurves(Curves=[item_12, item_9], Preserve=False)
scale_nu_2 = ScaleNU(Geometry=join, Plane=PlaneXY(0, 0, 0), ScaleX=item_11, ScaleY=item_10, ScaleZ=1)  # -> Geometry, Transform
pflip = FlipPlane(Plane=pframe, ReverseX=False, ReverseY=False, SwapAxes=True)
orient = Orient(Geometry=scale_nu_2.Geometry, Source=PlaneXY(0, 0, 0), Target=pflip)  # -> Geometry, Transform

# ----
pflip_2 = FlipPlane(Plane=pframe, ReverseX=True, ReverseY=False, SwapAxes=False)
orient_2 = Orient(Geometry=scale_nu_2.Geometry, Source=PlaneXY(0, 0, 0), Target=pflip_2)  # -> Geometry, Transform

# ---- group: Extrude the moulding profile along the slab perimeter (continued)
filter = StreamFilter(Gate=equals_5.Inequality, Stream0=orient_2.Geometry, Stream1=orient.Geometry)

# ----
swp1 = Sweep1(Rail=flip_2.Curve, Sections=filter, Miter=1)
cap_2 = CapHoles(Brep=swp1)

# ----
# For each slab, if the number of edges or the radius of the bottom polygon is different from the top one, use ruled surface instead of sweep
filter_2 = StreamFilter(Gate=item_5, Stream0=item_8, Stream1=cap_2)
ins = InsertItems(List=loop_start.Data, Item=filter_2, Indices=addition, Wrap=Toggle(False))
loop_end = LoopEnd(port=loop_start.port, Exit=False, Data=ins, TimeOutVal=0, pausedState=False, state="Constant output")
item_14 = ListItem(List=loop_end, Index=subtraction_2, Wrap=True)
cull_i = CullIndex(List=loop_end, Indices=subtraction_2, Wrap=True)
panel_7 = Panel(loop_end)
join_2 = BrepJoin(Breps=loop_end)  # -> Breps, Closed

# ---- group: Draw the arc for the boolean operations o the sides
scale_nu_3 = ScaleNU(Geometry=polygon_3.Polygon, Plane=PlaneXY(0, 0, 0), ScaleX="1.5", ScaleY="1.5", ScaleZ=1)  # -> Geometry, Transform
octogonal_slab = Panel("""0.0625000
0.1875000
0.3125000
0.4375000
0.5625000
0.6875000
0.8125000
0.9375000""")
# radius of the arc
number_slider_3 = Slider(0.036, range=0..0.125)
addition_2 = Addition(A=square_slab, B=number_slider_3)
eval = EvaluateCurve(Curve=reparameterize(scale_nu_3.Geometry), Parameter=square_slab)  # -> Point, Tangent, Angle
eval_2 = EvaluateCurve(Curve=reparameterize(scale_nu_3.Geometry), Parameter=addition_2)  # -> Point, Tangent, Angle
# depth of the arc
number_slider_4 = Slider(0.37, range=0..1)
dist = Distance(PointA=eval.Point, PointB=eval_2.Point)
# sharpness of the arc
number_slider_5 = Slider(0.681, range=0..1)
Z_4 = UnitZ(Factor=dist)
move_2 = Move(Geometry=eval.Point, Motion=Z_4)  # -> Geometry, Transform
move_3 = Move(Geometry=eval_2.Point, Motion=Z_4)  # -> Geometry, Transform
ln = Line(StartPoint=eval_2.Point, EndPoint=move_3.Geometry)
eval_3 = EvaluateCurve(Curve=reparameterize(ln), Parameter=number_slider_5)  # -> Point, Tangent, Angle
vec2pt_4 = Vector2Pt(PointA=move_2.Geometry, PointB=move_2.Geometry, Unitize=False)  # -> Vector, Length
vec2pt_5 = Vector2Pt(PointA=eval_2.Point, PointB=eval_3.Point, Unitize=False)  # -> Vector, Length

# ----
move_4 = Move(Geometry=scale_nu_3.Geometry, Motion=Z_2)  # -> Geometry, Transform

# ---- group: Draw the arc for the boolean operations o the sides (continued)
pcen = PolygonCenter(Polyline=move_4.Geometry)  # -> CenterV, CenterE, CenterA
ln_2 = Line(StartPoint=eval.Point, EndPoint=pcen.CenterV)
eval_4 = EvaluateCurve(Curve=ln_2, Parameter=number_slider_4)  # -> Point, Tangent, Angle
vec2pt_6 = Vector2Pt(PointA=eval.Point, PointB=eval_4.Point, Unitize=False)  # -> Vector, Length

# ----
bzspan_3 = BezierSpan(StartPoint=move_2.Geometry, StartTangent=vec2pt_4.Vector, EndPoint=eval_2.Point, EndTangent=vec2pt_5.Vector)  # -> Curve, Length, Domain

# ---- group: Boolean operation: cylinders on the sides
pl_3pt = Plane3Pt(PointA=pcen.CenterV, PointB=eval.Point, PointC=move_2.Geometry)
extr = Extrude(Base=bzspan_3.Curve, Direction=vec2pt_6.Vector)
mirror = Mirror(Geometry=extr, Plane=eval.Point)  # -> Geometry, Transform
mirror_2 = Mirror(Geometry=[mirror.Geometry, extr], Plane=pl_3pt)  # -> Geometry, Transform
join_3 = BrepJoin(Breps=[mirror_2.Geometry, mirror.Geometry, extr])  # -> Breps, Closed
capex = CapHolesEx(Brep=join_3.Breps)  # -> Brep, Caps, Solid

# ----
filter_3 = StreamFilter(Gate=list, Stream1=sph, Stream2=capex.Brep, Stream3=[sph, capex.Brep])  # -> flatten(Stream)
sdiff = SolidDifference(BrepsA=item_14, BrepsB=filter_3)
join_4 = BrepJoin(Breps=[sdiff, cull_i])  # -> Breps, Closed
filter_4 = StreamFilter(Gate=equals_4.Equality, Stream0=join_4.Breps, Stream1=join_2.Breps)
sdiff_2 = SolidDifference(BrepsA=filter_4, BrepsB=cyl)  # -> flatten(Result)
mjoin = MeshJoin(Meshes=sdiff_2)
preview = CustomPreview(Geometry=mjoin, Material=ColourSwatch(SwatchColor=RGB(165, 173, 181)))
